# Grasshopper definition box.gh (Grasshopper 1.0.8)

construct_point = ConstructPoint(XCoordinate=0, YCoordinate=0, ZCoordinate=0)
width = Number(5)
depth = Number(5)
height = Number(5)
divide_by_2 = DivideBy2(A=width)
divide_by_2_2 = DivideBy2_2(A=width)
move_x = MoveX(geometry=construct_point, factor=divide_by_2)
move_x_2 = MoveX_2(geometry=construct_point, factor=divide_by_2_2)
divide_by_2_3 = DivideBy2(A=depth)
divide_by_2_4 = DivideBy2_2(A=depth)
unit_y = UnitY(Factor=divide_by_2_3)
unit_y_2 = UnitY(Factor=divide_by_2_4)
move = Move(Geometry=move_x, Motion=unit_y)  # -> Geometry, Transform
move_2 = Move(Geometry=move_x_2, Motion=unit_y_2)  # -> Geometry, Transform
unit_z = UnitZ(Factor=height)
move_3 = Move(Geometry=move.Geometry, Motion=unit_z)  # -> Geometry, Transform
xy_plane = XYPlane(Origin=Point(0, 0, 0))
box_2pt = Box2Pt(PointA=move_2.Geometry, PointB=move_3.Geometry, Plane=xy_plane)
geometry = Geometry(box_2pt)
out = Geometry(geometry)

# ==== cluster DivideBy2
A = ClusterInput()
division = Division(A=A, B="2")
result = ClusterOutput(division)

# ==== cluster DivideBy2_2
A = ClusterInput()
division = Division(A=A, B="-2")
result = ClusterOutput(division)

# ==== cluster MoveX
geometry = ClusterInput()
factor = ClusterInput()
unit_x = UnitX(Factor=factor)
move = Move(Geometry=geometry, Motion=unit_x)  # -> Geometry, Transform
geometry_2 = ClusterOutput(move.Geometry)

# ==== cluster MoveX_2
factor = ClusterInput()
unit_x = UnitX(Factor=factor)
geometry = ClusterInput()
move = Move(Geometry=geometry, Motion=unit_x)  # -> Geometry, Transform
geometry_2 = ClusterOutput(move.Geometry)
