# Grasshopper definition geojson-rh.gh (Grasshopper 1.0.8)
# plug-ins: Geospatial

panel = Panel("-73.98187458515167")
panel_2 = Panel("40.754674479887605")
file_path = FilePath("C:\Users\Varun SA\Documents\computational-modelling\2-web-interops\ref.geojson")
read_geojson = ReadGeoJSON(File=file_path, Mode=False)  # -> Type, Geometry, Keys, Values
epsg_32618 = Panel("""PROJCS["WGS 84 / UTM zone 18N",
  GEOGCS["WGS 84",
    DATUM["WGS_1984",
      SPHEROID["WGS 84",6378137,298.257223563,
        AUTHORITY["EPSG","7030"]],
      AUTHORITY["EPSG","6326"]],
    PRIMEM["Greenwich",0,
      AUTHORITY["EPSG","8901"]],
    UNIT["degree",0.0174532925199433,
      AUTHORITY["EPSG","9122"]],
    AUTHORITY["EPSG","4326"]],
  PROJECTION["Transverse_Mercator"],
  PARAMETER["latitude_of_origin",0],
  PARAMETER["central_meridian",-75],
  PARAMETER["scale_factor",0.9996],
  PARAMETER["false_easting",500000],
  PARAMETER["false_northing",0],
  UNIT["metre",1,
    AUTHORITY["EPSG","9001"]],
  AUTHORITY["EPSG","32618"]]""")
_1_epsg_4326 = _1EPSG4326()
geometry = Geometry(read_geojson.Geometry)
scale = Scale(Geometry=geometry, Center=Point(0, 0, 0), Factor="1")  # -> Geometry, Transform
_2_transformation = _2Transformation(SourceWKT=_1_epsg_4326, TargetWKT=epsg_32618)
panel_3 = Panel(scale.Geometry)
geometry_2 = Geometry(scale.Geometry)
discontinuity = Discontinuity(Curve=geometry_2, Level=1)  # -> flatten(Points), Parameters
panel_4 = Panel(_2_transformation)
panel_5 = Panel(discontinuity.Points)
_4_reprojection = _4Reprojection(SourcePoints=discontinuity.Points, Transformation=_2_transformation)
geometry_3 = Geometry(_4_reprojection)
panel_6 = Panel(geometry_3)
polyline = PolyLine(Vertices=geometry_3, Closed=Toggle(True))
polygon_center = PolygonCenter(Polyline=polyline)  # -> CenterV, CenterE, flatten(CenterA)
construct_point = ConstructPoint(XCoordinate=0, YCoordinate=0, ZCoordinate=0)
panel_7 = Panel(polygon_center.CenterA)
vector_2pt = Vector2Pt(PointA=polygon_center.CenterA, PointB=construct_point, Unitize=False)  # -> Vector, Length
move = Move(Geometry=polyline, Motion=vector_2pt.Vector)  # -> flatten(Geometry), Transform
panel_8 = Panel(vector_2pt.Vector)
panel_9 = Panel(move.Geometry)
geometry_4 = Geometry(move.Geometry)
