# Grasshopper definition target-view-network.gh (Grasshopper 1.0.8)
# plug-ins: CORE.Toolbox.Grasshopper, Wombat

number_slider = Slider(6, range=0..100)
curve = Curve(<curve referenced from the Rhino model>)
addition = Addition(A=number_slider, B="1")
divide_curve = DivideCurve(Curve=curve, Count=number_slider, Kinks=False)  # -> Points, Tangents, Parameters
geometry_pipeline = GeometryPipeline(
    GroupByLayer=False,
    GroupByType=False,
    IncludeHidden=True,
    IncludeLocked=True,
    LayerFilter="Default",
    NameFilter="*",
    SublayerFiltering=True,
    TypeFilter=1073741848)
point = Point(graft(divide_curve.Points))
geometry = Geometry(geometry_pipeline)
surface_center = SurfaceCenter(Surface=geometry)  # -> Center, Normal, Frame
panel = Panel(point)
scale = Scale(Geometry=geometry, Center=surface_center.Center, Factor=".98")  # -> Geometry, Transform
brep = Brep(<brep referenced from the Rhino model>)
colour_rgb = ColourRGB(Alpha=255, Red=Slider(237, range=0..255), Green=Slider(240, range=0..255), Blue=Slider(255, range=0..255))
mesh_join = MeshJoin(Meshes=flatten(scale.Geometry))
set_material = SetMaterial(DiffuseColor=colour_rgb)  # -> Attribute, PBRMaterial
panel_2 = Panel(mesh_join)
deconstruct_brep = DeconstructBrep(Brep=brep)  # -> Faces, Edges, Vertices
custom_preview = CustomPreview(Geometry=mesh_join, Material=set_material.PBRMaterial)
subdivision_size = Panel("10")
srf_open_space = Surface(deconstruct_brep.Faces)
surface = Surface(flatten(deconstruct_brep.Faces))
srf_for_subdivision = Surface(graft(srf_open_space))
int_subdivision_size = Integer(subdivision_size)
dimensions = Dimensions(Surface=srf_for_subdivision)  # -> UDimension, VDimension
division = Division(A=dimensions.UDimension, B=int_subdivision_size)
division_2 = Division(A=dimensions.VDimension, B=int_subdivision_size)
divide_domain² = DivideDomain²(Domain=srf_for_subdivision, UCount=division, VCount=division_2)
isotrim = Isotrim(Surface=srf_for_subdivision, Domain=divide_domain²)
srf_analysis_surfaces = Surface(isotrim)
evaluate_surface = EvaluateSurface(Surface=reparameterize(srf_analysis_surfaces), Point="{0.5,0.5,0}")  # -> Point, Normal, UDirection, VDirection, Frame
surface_2 = Surface(flatten(srf_analysis_surfaces))
point_2 = Point(flatten(evaluate_surface.Point))
line = Line(StartPoint=point, EndPoint=point_2)
vector = Vector(flatten(line))
occlusion = Occlusion(Samples=point_2, Obstructions=mesh_join, Rays=vector)  # -> Hits, simplify(Occlusion)
list_length_py = Python3Script(x=vector)  # -> a; inputs x: list
# ---------- list_length_py: Python ----------
a = len(x)

print(a)
# ---------- end list_length_py ----------
panel_3 = Panel(occlusion.Hits)
subtraction = Subtraction(A=list_length_py, B=occlusion.Hits)
addition_2 = Addition(A=subtraction, B="1")
panel_4 = Panel(addition_2)
path_mapper = PathMapper(occlusion.Occlusion, source=["{A;B}", "{A}"], target=["{B}", "{A}"])
mass_addition = MassAddition(Input=path_mapper)  # -> Result, PartialResults
panel_5 = Panel(list_length_py)
panel_6 = Panel(mass_addition.Result)
gradient = Gradient(
    LowerLimit="0",
    UpperLimit=list_length_py,
    Parameter=addition_2,
    stops=[0: RGB(0, 128, 128), 0.355: RGB(255, 255, 0), 0.698: RGB(255, 0, 0)])
panel_7 = Panel(gradient)
col_view_analysis_color = Colour(gradient)
set_material_2 = SetMaterial(DiffuseColor=gradient)  # -> Attribute, PBRMaterial
custom_preview_2 = CustomPreview(Geometry=surface_2, Material=col_view_analysis_color)
